# Grasshopper definition 01.point_gcode.gh (Grasshopper 1.0.8)

panel = Panel("""0, 0, 0
50, 0, 0
50, 50, 0
0, 50, 0""")
item = ListItem(List=panel, Index=0, Wrap=True)
lng = ListLength(List=panel)
ins = InsertItems(List=panel, Item=item, Indices=lng, Wrap=True)
panel_2 = Panel(ins)
pline = PolyLine(Vertices=panel_2, Closed=False)
pdecon = Deconstruct(Point=panel_2)  # -> XComponent, YComponent, ZComponent
explode = Explode(Curve=pline, Recursive=True)  # -> Segments, Vertices
multiplication = Multiplication(A="30 ", B="60 ")
len = Length(Curve=explode.Segments)
ins_2 = InsertItems(List=len, Item="0", Indices="0", Wrap=True)
ma = MassAddition(Input=ins_2)  # -> Result, PartialResults
concat = Concatenate(
    FragmentH="G1 ",
    FragmentG="F",
    FragmentJ=multiplication,
    FragmentA=" X",
    FragmentB=pdecon.XComponent,
    FragmentC=" Y",
    FragmentD=pdecon.YComponent,
    FragmentE=" Z",
    FragmentF=pdecon.ZComponent,
    FragmentI=" E",
    FragmentK=ma.PartialResults)
panel_3 = Panel("""; -- START GCODE --
G90
M82
G28
G92 E0.0000
G1 E-4.0000 F6000
; -- end of START GCODE --""")
panel_4 = Panel("""; -- END GCODE --
G92 E0.0000
G1 E-4.0000 F6000
G28
; -- end of END GCODE --""")
merge = Merge(Data1=flatten(panel_3), Data2=flatten(concat), Data3=flatten(panel_4))
panel_5 = Panel(merge)
