# Grasshopper definition 02.polyline_point_gcode.gh (Grasshopper 1.0.8)
# plug-ins: RhinoCodePluginGH

# ----
# Example-1
panel = Panel("""0,0,0
0,50,0
25,0,0
50,50,0
50,0,0""")
pline = PolyLine(Vertices=panel, Closed=False)
cp = ControlPoints(Curve=pline)  # -> Points, Weights, Knots
cpoly = ControlPolygon(Curve=pline)  # -> Polygon, Points
disc = Discontinuity(Curve=pline, Level=1)  # -> Points, Parameters
panel_2 = Panel(cp.Points)
panel_3 = Panel(cpoly.Points)
panel_4 = Panel(disc.Points)

# ----
# Example-2
panel_5 = Panel("""0,0,0
10,0,0
20,0,0
20,10,0
30,10,0""")
pline_2 = PolyLine(Vertices=panel_5, Closed=False)
cp_2 = ControlPoints(Curve=pline_2)  # -> Points, Weights, Knots
cpoly_2 = ControlPolygon(Curve=pline_2)  # -> Polygon, Points
disc_2 = Discontinuity(Curve=pline_2, Level=1)  # -> Points, Parameters
panel_6 = Panel(cp_2.Points)
panel_7 = Panel(cpoly_2.Points)
panel_8 = Panel(disc_2.Points)

# ----
# Example-3
panel_9 = Panel("""0,0,0
20,0,0
20,20,0
0,20,0
0,0,0""")
pline_3 = PolyLine(Vertices=panel_9, Closed=False)
cp_3 = ControlPoints(Curve=pline_3)  # -> Points, Weights, Knots
cpoly_3 = ControlPolygon(Curve=pline_3)  # -> Polygon, Points
disc_3 = Discontinuity(Curve=pline_3, Level=1)  # -> Points, Parameters
panel_10 = Panel(cp_3.Points)
panel_11 = Panel(cpoly_3.Points)
panel_12 = Panel(disc_3.Points)

# ----
# Inputs
number_slider = Slider(3, range=0.5..3)
is_open = BooleanToggle(True)

# ----
# Example-7A
# Visualizing tool path for multiple layers for open or closed layers
# When the layers (polylines) are open, there is a traveling problem!
number_slider_2 = Slider(2, range=0.5..3)
is_open_2 = BooleanToggle(True)
py3 = Python3Script(is_open=is_open_2, num_layers=Slider(8, range=2..10), h_layer=number_slider_2)  # -> out
# ---------- py3: Python ----------
import Rhino.Geometry as rg

polylines = []
layer_points = []
z = 0.
for layer in range(int(num_layers)):
    
    layer_points = [
        rg.Point3d(0, 0, z),
        rg.Point3d(0, 10, z),
        rg.Point3d(10, 10, z),
        rg.Point3d(10, 0, z)
        ]
    
    if not is_open:
        layer_points.append(rg.Point3d(0, 0, z))
    
    polylines.append(rg.Polyline(layer_points))
    
    z += h_layer

# Output the list of polylines
out = polylines
# ---------- end py3 ----------
cp_4 = ControlPoints(Curve=py3)  # -> Points, Weights, Knots
pline_4 = PolyLine(Vertices=flatten(cp_4.Points), Closed=False)

# ----
# Prepare curves (layers)
py3_2 = Python3Script(is_open=is_open, num_layers=Slider(10, range=2..10), h_layer=number_slider)  # -> out
# ---------- py3_2: Python ----------
import Rhino.Geometry as rg

polylines = []
layer_points = []
z = 0.
for layer in range(int(num_layers)):
    
    layer_points = [
        rg.Point3d(10, -50, z),
        rg.Point3d(10, -10, z),
        rg.Point3d(50, -10, z),
        rg.Point3d(50, -50, z)
        ]
    
    if not is_open:
        layer_points.append(rg.Point3d(10, -50, z))
    
    polylines.append(rg.Polyline(layer_points))
    
    z += h_layer

# Output the list of polylines
out = polylines
# ---------- end py3_2 ----------
crv = Curve(py3_2)

# ----
# Flip the direction of every other curve
dispatch = Dispatch(List=crv, DispatchPattern=[True, False])  # -> ListA, ListB
flip = FlipCurve(Curve=dispatch.ListB)  # -> Curve, Flag
weave = Weave(Pattern=[0, 1], Stream0=dispatch.ListA, Stream1=flip.Curve, NullGaps=False)

# ----
# Example-4
panel_13 = Panel("""20,0,0
30,0,0
30,10,0""")
panel_14 = Panel("""0,0,0
10,0,0
10,10,0""")
pline_5 = PolyLine(Vertices=panel_14, Closed=False)
pline_6 = PolyLine(Vertices=panel_13, Closed=False)
crv_2 = Curve([pline_5, pline_6])
cp_5 = ControlPoints(Curve=crv_2)  # -> Points, Weights, Knots
explode = Explode(Curve=crv_2, Recursive=True)  # -> Segments, Vertices
panel_15 = Panel(explode.Segments)
panel_16 = Panel(cp_5.Points)
len = Length(Curve=explode.Segments)
panel_17 = Panel(explode.Vertices)
pdecon = Deconstruct(Point=flatten(panel_16))  # -> XComponent, YComponent, ZComponent
ins = InsertItems(List=len, Item="0", Indices="0", Wrap=True)
multiplication = Multiplication(A="30 ", B="60 ")
panel_18 = Panel(ins)
ma = MassAddition(Input=flatten(ins))  # -> Result, PartialResults
concat = Concatenate(
    FragmentH="G1 ",
    FragmentG="F",
    FragmentJ=multiplication,
    FragmentA=" X",
    FragmentB=pdecon.XComponent,
    FragmentC=" Y",
    FragmentD=pdecon.YComponent,
    FragmentE=" Z",
    FragmentF=pdecon.ZComponent,
    FragmentI=" E",
    FragmentK=ma.PartialResults)
panel_19 = Panel(ma.PartialResults)
panel_20 = Panel("""; -- START GCODE --
G90
M82
G28
G92 E0.0000
G1 E-4.0000 F6000
; -- end of START GCODE --""")
panel_21 = Panel("""; -- END GCODE --
G92 E0.0000
G1 E-4.0000 F6000
G28
; -- end of END GCODE --""")
merge = Merge(Data1=flatten(panel_20), Data2=flatten(concat), Data3=flatten(panel_21))
panel_22 = Panel(merge)

# ----
# Example-5
# (Two closed curves -- a smaller square within a bigger square
# within the same plane.
# Same pipeline from Ex-4 represented as a Cluster)
panel_23 = Panel("""0,0,0
10,0,0
10,10,0
0,10,0
0,0,0""")
panel_24 = Panel("""3,3,0
7,3,0
7,7,0
3,7,0
3,3,0""")
cluster = Cluster(V=panel_23, V_2=panel_24)
panel_25 = Panel(cluster)

# ----
# Extrusion rate calculation
explode_2 = Explode(Curve=weave, Recursive=True)  # -> Segments, Vertices
len_2 = Length(Curve=explode_2.Segments)
ins_2 = InsertItems(List=len_2, Item="0", Indices="0", Wrap=True)
ma_2 = MassAddition(Input=flatten(ins_2))  # -> Result, PartialResults

# ----
# Prepare Gcode
cp_6 = ControlPoints(Curve=weave)  # -> Points, Weights, Knots
pdecon_2 = Deconstruct(Point=flatten(cp_6.Points))  # -> XComponent, YComponent, ZComponent
multiplication_2 = Multiplication(A="30 ", B="60 ")
concat_2 = Concatenate(
    FragmentH="G1 ",
    FragmentG="F",
    FragmentJ=multiplication_2,
    FragmentA=" X",
    FragmentB=pdecon_2.XComponent,
    FragmentC=" Y",
    FragmentD=pdecon_2.YComponent,
    FragmentE=" Z",
    FragmentF=pdecon_2.ZComponent,
    FragmentI=" E",
    FragmentK=ma_2.PartialResults)
panel_26 = Panel("""; -- START GCODE --
G90
M82
G28
G92 E0.0000
G1 E-4.0000 F6000
; -- end of START GCODE --""")
panel_27 = Panel("""; -- END GCODE --
G92 E0.0000
G1 E-4.0000 F6000
G28
; -- end of END GCODE --""")
merge_2 = Merge(Data1=flatten(panel_26), Data2=flatten(concat_2), Data3=flatten(panel_27))

# ----
# Visualization of tool path
pline_7 = PolyLine(Vertices=flatten(cp_6.Points), Closed=False)

panel_28 = Panel("""0,-10,2
15,-30,2
30,-10,2""")

# ----
# Example-6
# (Two open curves stacked in Z-direction.
# Demonstration of the traveling problem with two or more open polylines.)
panel_29 = Panel("""0,-10,0
15,-30,0
30,-10,0""")
cluster_2 = Cluster(V=panel_29, V_2=panel_28)
panel_30 = Panel(cluster_2)

# ----
# Exercise-7B
panel_31 = Panel(merge_2)

# ==== cluster Cluster
V = ClusterInput()
V_2 = ClusterInput()
pline = PolyLine(Vertices=V, Closed=False)
pline_2 = PolyLine(Vertices=V_2, Closed=False)
crv = Curve([pline, pline_2])
cp = ControlPoints(Curve=crv)  # -> Points, Weights, Knots
explode = Explode(Curve=crv, Recursive=True)  # -> Segments, Vertices
len = Length(Curve=explode.Segments)
pdecon = Deconstruct(Point=flatten(cp.Points))  # -> XComponent, YComponent, ZComponent
ins = InsertItems(List=len, Item="0", Indices="0", Wrap=True)
multiplication = Multiplication(A="30 ", B="60 ")
ma = MassAddition(Input=flatten(ins))  # -> Result, PartialResults
concat = Concatenate(
    FragmentH="G1 ",
    FragmentG="F",
    FragmentJ=multiplication,
    FragmentA=" X",
    FragmentB=pdecon.XComponent,
    FragmentC=" Y",
    FragmentD=pdecon.YComponent,
    FragmentE=" Z",
    FragmentF=pdecon.ZComponent,
    FragmentI=" E",
    FragmentK=ma.PartialResults)
panel = Panel("""; -- START GCODE --
G90
M82
G28
G92 E0.0000
G1 E-4.0000 F6000
; -- end of START GCODE --""")
panel_2 = Panel("""; -- END GCODE --
G92 E0.0000
G1 E-4.0000 F6000
G28
; -- end of END GCODE --""")
merge = Merge(Data1=flatten(panel), Data2=flatten(concat), Data3=flatten(panel_2))
R = ClusterOutput(merge)
