# Grasshopper definition 03.curve_point_xyz_gcode.gh (Grasshopper 1.0.8)

# ----
# Tolerance (distance): Deviation tolerance.
# Max distance between the curve and the
# resultant polyline.
number_slider = Slider(0.06, range=0.01..5)
crv = Curve(<curve referenced from the Rhino model>)
topoly = CurveToPolyline(Curve=crv, ToleranceDistance=number_slider, ToleranceAngle=0)  # -> Polyline, Segments
cp = ControlPoints(Curve=topoly.Polyline)  # -> Points, Weights, Knots
panel = Panel(topoly.Segments)
pline = PolyLine(Vertices=cp.Points, Closed=False)

# ----
# 1a. Divide Curve
crv_2 = Curve(<curve referenced from the Rhino model>)
divide = DivideCurve(Curve=crv_2, Count="100", Kinks=False)  # -> Points, Tangents, Parameters
len = Length(Curve=crv_2)
multiplication = Multiplication(A=divide.Tangents, B=Slider(1, range=1..3))
panel_2 = Panel(divide.Points)
lng = ListLength(List=divide.Points)
panel_3 = Panel(len)
panel_4 = Panel(lng)
vdis = VectorDisplay(Anchor=divide.Points, Vector=multiplication)

crv_3 = Curve(reparameterize(<curve referenced from the Rhino model>))
# Tolerance (angle) works better than the others (i.e., Tolerance-distance, Min-MaxEdge) in the areas with more curvatures, but doesn't work on the points in the straight ones.
# 
# The opposite behavior happens with the MaxEdge option.
# 
# For the same amount of points, Tolerance (distance) is the mos equilibrated option for the different parts of the curve.
panel_5 = Panel("0.0605")
topoly_2 = CurveToPolyline(Curve=crv_3, ToleranceDistance=panel_5, ToleranceAngle=0)  # -> Polyline, Segments
cp_2 = ControlPoints(Curve=topoly_2.Polyline)  # -> Points, Weights, Knots
panel_6 = Panel(topoly_2.Segments)
eval = EvaluateCurve(Curve=crv_3, Parameter=cp_2.Knots)  # -> Point, Tangent, Angle
lng_2 = ListLength(List=cp_2.Points)
pline_2 = PolyLine(Vertices=cp_2.Points, Closed=False)
multiplication_2 = Multiplication(A=eval.Tangent, B=Slider(2, range=1..10))
panel_7 = Panel(lng_2)
vdis_2 = VectorDisplay(Anchor=eval.Point, Vector=multiplication_2)

# ----
# 1b. Divide Length
crv_4 = Curve(<curve referenced from the Rhino model>)
# Divide Tools
len_2 = Length(Curve=crv_4)
divlength = DivideLength(Curve=crv_4, Length="1")  # -> Points, Tangents, Parameters
panel_8 = Panel(len_2)
panel_9 = Panel(divlength.Points)
lng_3 = ListLength(List=divlength.Points)
panel_10 = Panel(lng_3)

# ----
# Tolerance (angle): Max angle between the
# tangent vectorto the curve at a point and the
# polyline at the same point.
number_slider_2 = Slider(22.9, range=0.1..90)
crv_5 = Curve(reparameterize(<curve referenced from the Rhino model>))
# Curve-to-Polyline
topoly_3 = CurveToPolyline(Curve=crv_5, ToleranceDistance=0, ToleranceAngle=degrees(number_slider_2))  # -> Polyline, Segments
panel_11 = Panel(topoly_3.Segments)
cp_3 = ControlPoints(Curve=topoly_3.Polyline)  # -> Points, Weights, Knots
eval_2 = EvaluateCurve(Curve=crv_5, Parameter=cp_3.Knots)  # -> Point, Tangent, Angle
pline_3 = PolyLine(Vertices=cp_3.Points, Closed=False)
multiplication_3 = Multiplication(A=eval_2.Tangent, B=Slider(10, range=1..10))
vdis_3 = VectorDisplay(Anchor=eval_2.Point, Vector=multiplication_3)

crv_6 = Curve(reparameterize(<curve referenced from the Rhino model>))
topoly_4 = CurveToPolyline(Curve=crv_6, ToleranceDistance=0, ToleranceAngle=degrees("13.88"))  # -> Polyline, Segments
cp_4 = ControlPoints(Curve=topoly_4.Polyline)  # -> Points, Weights, Knots
eval_3 = EvaluateCurve(Curve=crv_6, Parameter=cp_4.Knots)  # -> Point, Tangent, Angle
pline_4 = PolyLine(Vertices=cp_4.Points, Closed=False)
lng_4 = ListLength(List=cp_4.Points)
multiplication_4 = Multiplication(A=eval_3.Tangent, B=Slider(2, range=1..10))
panel_12 = Panel(lng_4)
vdis_4 = VectorDisplay(Anchor=eval_3.Point, Vector=multiplication_4)

# ----
# 1c. Divide Distance
crv_7 = Curve(<curve referenced from the Rhino model>)
divdist = DivideDistance(Curve=crv_7, Distance="1")  # -> Points, Tangents, Parameters
panel_13 = Panel(divdist.Points)
lng_5 = ListLength(List=divdist.Points)
panel_14 = Panel(lng_5)

crv_8 = Curve(reparameterize(<curve referenced from the Rhino model>))
topoly_5 = CurveToPolyline(Curve=crv_8, ToleranceDistance=0, ToleranceAngle=degrees(0), MaxEdge="3.5")  # -> Polyline, Segments
cp_5 = ControlPoints(Curve=topoly_5.Polyline)  # -> Points, Weights, Knots
eval_4 = EvaluateCurve(Curve=crv_8, Parameter=cp_5.Knots)  # -> Point, Tangent, Angle
pline_5 = PolyLine(Vertices=cp_5.Points, Closed=False)
lng_6 = ListLength(List=cp_5.Points)
multiplication_5 = Multiplication(A=eval_4.Tangent, B=Slider(2, range=1..10))
panel_15 = Panel(lng_6)
vdis_5 = VectorDisplay(Anchor=eval_4.Point, Vector=multiplication_5)

# ----
# MinEdge: Min allowed segment length
# MaxEdge: Max allowed segment length
number_slider_3 = Slider(6, range=0.1..6)
crv_9 = Curve(reparameterize(<curve referenced from the Rhino model>))
eval_5 = EvaluateCurve(Curve=crv_9, Parameter=Slider(0, range=0..1))  # -> Point, Tangent, Angle
topoly_6 = CurveToPolyline(Curve=crv_9, ToleranceDistance=0, ToleranceAngle=0, MinEdge=number_slider_3)  # -> Polyline, Segments
multiplication_6 = Multiplication(A=eval_5.Tangent, B=Slider(10, range=1..10))
cp_6 = ControlPoints(Curve=topoly_6.Polyline)  # -> Points, Weights, Knots
panel_16 = Panel(topoly_6.Segments)
vdis_6 = VectorDisplay(Anchor=eval_5.Point, Vector=multiplication_6)
pline_6 = PolyLine(Vertices=cp_6.Points, Closed=False)

number_slider_4 = Slider(12, range=7..12)
